# Grasshopper definition Voronoi_Mold.gh (Grasshopper 1.0.7)
# plug-ins: Bifocals

surface = Surface(<surface referenced from the Rhino model>)
populate_2d = Populate2D(Region=surface, Count=Slider(81, range=0..1000), Seed=Slider(27, range=0..100))
curve = Curve(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)
voronoi = Voronoi(Points=populate_2d, Boundary=surface, BruteForceOverride=False)
pull_point = PullPoint(Point=populate_2d, Geometry=curve, ClosestOnly=True)  # -> ClosestPoint, Distance
construct_domain = ConstructDomain(DomainStart=Slider(0.4, range=0..1), DomainEnd=Slider(0.7, range=0..1))
bounds = Bounds(Numbers=pull_point.Distance)
area = Area(Geometry=voronoi)  # -> Area, Centroid
remap_numbers = RemapNumbers(Value=pull_point.Distance, Source=bounds, Target=construct_domain)  # -> Mapped, Clipped
scale = Scale(Geometry=voronoi, Center=area.Centroid, Factor=remap_numbers.Mapped)  # -> Geometry, Transform
merge = Merge(Data1=voronoi, Data2=scale.Geometry)
