# Grasshopper definition Parametric_Molds_gh_script.gh (Grasshopper 1.0.8)
# plug-ins: Pufferfish, Bifocals

# ---- group: Mesh to Brep
mesh = Mesh(<mesh referenced from the Rhino model>)
face_boundaries = FaceBoundaries(Mesh=mesh)
boundary_surfaces = BoundarySurfaces(Edges=face_boundaries)
brep_join = BrepJoin(Breps=boundary_surfaces)  # -> Breps, Closed
brep = Brep(brep_join.Breps)

# ----
plane_normal = PlaneNormal(Origin=Point(0, 0, 0), ZAxis=Vector(0, 0, 1))
area = Area(Geometry=plane_normal)  # -> Area, Centroid

point = Point(Point(-1, 1, 0))
point_2 = Point(Point(1, 1, 0))
point_3 = Point(Point(1, -1, 0))
point_4 = Point(Point(-1, -1, 0))
_4point_surface = _4PointSurface(CornerA=point, CornerB=point_2, CornerC=point_3, CornerD=point_4)
area_2 = Area(Geometry=_4point_surface)  # -> Area, Centroid

# ---- group: Center Object
bounding_box = BoundingBox(Content=brep, Plane=PlaneXY(0, 0, 0))  # -> Box, Box_2
deconstruct_brep = DeconstructBrep(Brep=bounding_box.Box)  # -> Faces, Edges, Vertices
list_item = ListItem(List=deconstruct_brep.Faces, Index=Slider(4, range=0..5), Wrap=True)
area_3 = Area(Geometry=list_item)  # -> Area, Centroid
move_to_point = MoveToPoint(Geometry=brep, PointA=area_3.Centroid, PointB=area.Centroid)  # -> Moved, Vector, Transform

# ----
unit_z = UnitZ(Factor=1)
polygon = Polygon(Plane=area.Centroid, Radius=Slider(200, range=0..1000), Segments="4", FilletRadius=0)  # -> Polygon, Length
unit_z_2 = UnitZ(Factor=Slider(230, range=0..1000))
line_sdl = LineSDL(Start=area.Centroid, Direction=unit_z, Length=Slider(3, range=0..10))
extrude = Extrude(Base=polygon.Polygon, Direction=unit_z_2)
cap_holes = CapHoles(Brep=extrude)
rotate_axis = RotateAxis(Geometry=cap_holes, Angle=degrees(Slider(45, range=0..100)), Axis=line_sdl)  # -> Geometry, Transform

bounding_box_2 = BoundingBox(Content=move_to_point.Moved, Plane=PlaneXY(0, 0, 0))  # -> Box, Box_2
scale = Scale(Geometry=bounding_box_2.Box, Center=area.Centroid, Factor=0.5)  # -> Geometry, Transform
box_morph = BoxMorph()

mesh_2 = Mesh(<mesh referenced from the Rhino model>)
subd_from_mesh = SubDFromMesh(Mesh=mesh_2, Creases=1, Corners=1, Interpolate=False)

bounding_box_3 = BoundingBox(Content=subd_from_mesh, Plane=PlaneXY(0, 0, 0))  # -> Box, Box_2
deconstruct_brep_2 = DeconstructBrep(Brep=bounding_box_3.Box)  # -> Faces, Edges, Vertices
list_item_2 = ListItem(List=deconstruct_brep_2.Faces, Index="4", Wrap=True)
area_4 = Area(Geometry=list_item_2)  # -> Area, Centroid

move_to_point_2 = MoveToPoint(Geometry=subd_from_mesh, PointA=area_4.Centroid, PointB=area_2.Centroid)  # -> Moved, Vector, Transform

bounding_box_4 = BoundingBox(Content=move_to_point_2.Moved, Plane=PlaneXY(0, 0, 0))  # -> Box, Box_2
number_slider = Slider(200, range=0..1000)
deconstruct_brep_3 = DeconstructBrep(Brep=bounding_box_4.Box)  # -> Faces, Edges, Vertices
brep_2 = Brep(move_to_point_2.Moved)
list_item_3 = ListItem(List=deconstruct_brep_3.Faces, Index="4", Wrap=True)
unit_z_3 = UnitZ(Factor=Slider(230, range=0..1000))
plane = Plane(list_item_3)
rectangle = Rectangle(Plane=plane, XSize=number_slider, YSize=number_slider, Radius=0)  # -> Rectangle, Length
extrude_2 = Extrude(Base=rectangle.Rectangle, Direction=unit_z_3)
area_5 = Area(Geometry=list_item_3)  # -> Area, Centroid
cap_holes_2 = CapHoles(Brep=extrude_2)
deconstruct_brep_4 = DeconstructBrep(Brep=cap_holes_2)  # -> Faces, Edges, Vertices
list_item_4 = ListItem(List=deconstruct_brep_4.Faces, Index="2", Wrap=True)
area_6 = Area(Geometry=list_item_4)  # -> Area, Centroid
move_to_point_3 = MoveToPoint(Geometry=cap_holes_2, PointA=area_6.Centroid, PointB=area_5.Centroid)  # -> Moved, Vector, Transform

box_morph_2 = BoxMorph(Geometry=brep_2, Reference=bounding_box_4.Box, Target=move_to_point_3.Moved)
