# Grasshopper definition Try_parametric_Molds.gh (Grasshopper 1.0.8)
# plug-ins: Pufferfish, Bifocals

point = Point(Point(-1, 1, 0))
point_2 = Point(Point(1, 1, 0))
point_3 = Point(Point(1, -1, 0))
point_4 = Point(Point(-1, -1, 0))
_4point_surface = _4PointSurface(CornerA=point, CornerB=point_2, CornerC=point_3, CornerD=point_4)
area = Area(Geometry=_4point_surface)  # -> Area, Centroid

number_slider = Slider(12, range=0..100)
construct_domain = ConstructDomain(DomainStart=Slider(10, range=0..10), DomainEnd=Slider(5, range=0.5..5))
number_slider_2 = Slider(12, range=0..100)
unit_y = UnitY(Factor=Slider(-71, range=-200..200))
construct_domain_2 = ConstructDomain(DomainStart=Slider(10, range=0..10), DomainEnd=Slider(5, range=0.5..5))
range = Range(Domain=construct_domain, Steps=number_slider)
range_2 = Range(Domain=construct_domain_2, Steps=number_slider_2)

mesh = Mesh(<mesh referenced from the Rhino model>)
subd_from_mesh = SubDFromMesh(Mesh=mesh, Creases=1, Corners=1, Interpolate=False)

bounding_box = BoundingBox(Content=subd_from_mesh, Plane=PlaneXY(0, 0, 0))  # -> Box, Box_2
deconstruct_brep = DeconstructBrep(Brep=bounding_box.Box)  # -> Faces, Edges, Vertices
list_item = ListItem(List=deconstruct_brep.Faces, Index="4", Wrap=True)
area_2 = Area(Geometry=list_item)  # -> Area, Centroid

move_to_point = MoveToPoint(Geometry=subd_from_mesh, PointA=area_2.Centroid, PointB=area.Centroid)  # -> Moved, Vector, Transform

bounding_box_2 = BoundingBox(Content=move_to_point.Moved, Plane=PlaneXY(0, 0, 0))  # -> Box, Box_2
number_slider_3 = Slider(200, range=0..1000)
deconstruct_brep_2 = DeconstructBrep(Brep=bounding_box_2.Box)  # -> Faces, Edges, Vertices
brep = Brep(move_to_point.Moved)
list_item_2 = ListItem(List=deconstruct_brep_2.Faces, Index="4", Wrap=True)
unit_z = UnitZ(Factor=Slider(230, range=0..1000))
plane = Plane(list_item_2)
rectangle = Rectangle(Plane=plane, XSize=number_slider_3, YSize=number_slider_3, Radius=0)  # -> Rectangle, Length
extrude = Extrude(Base=rectangle.Rectangle, Direction=unit_z)
area_3 = Area(Geometry=list_item_2)  # -> Area, Centroid
cap_holes = CapHoles(Brep=extrude)
deconstruct_brep_3 = DeconstructBrep(Brep=cap_holes)  # -> Faces, Edges, Vertices
list_item_3 = ListItem(List=deconstruct_brep_3.Faces, Index="2", Wrap=True)
area_4 = Area(Geometry=list_item_3)  # -> Area, Centroid
move_to_point_2 = MoveToPoint(Geometry=cap_holes, PointA=area_4.Centroid, PointB=area_3.Centroid)  # -> Moved, Vector, Transform
brep_2 = Brep(move_to_point_2.Moved)

scale_to_volume = ScaleToVolume(Geometry=brep, Plane=plane, Volume=brep_2, FactorX=1, FactorY=1, FactorZ=1)  # -> Scaled, Transform
deconstruct_brep_4 = DeconstructBrep(Brep=brep_2)  # -> Faces, Edges, Vertices
area_5 = Area(Geometry=scale_to_volume.Scaled)  # -> Area, Centroid
list_item_4 = ListItem(List=deconstruct_brep_4.Faces, Index="1", Wrap=True)
move = Move(Geometry=list_item_4, Motion=Vector(0, 0, 10))  # -> Geometry, Transform
area_6 = Area(Geometry=move.Geometry)  # -> Area, Centroid
line = Line(StartPoint=area_6.Centroid, EndPoint=area_5.Centroid)
divide_curve = DivideCurve(Curve=line, Count=number_slider, Kinks=False)  # -> Points, Tangents, Parameters
move_2 = Move(Geometry=area_6.Centroid, Motion=unit_y)  # -> Geometry, Transform
line_2 = Line(StartPoint=move_2.Geometry, EndPoint=area_5.Centroid)
divide_curve_2 = DivideCurve(Curve=line_2, Count=number_slider_2, Kinks=False)  # -> Points, Tangents, Parameters
pipe_variable = PipeVariable(Curve=line, Parameters=divide_curve.Parameters, Radii=range, Caps=0)
pipe_variable_2 = PipeVariable(Curve=line_2, Parameters=divide_curve_2.Parameters, Radii=range_2, Caps=0)
cap_holes_2 = CapHoles(Brep=pipe_variable_2)
cap_holes_3 = CapHoles(Brep=pipe_variable)
brep_3 = Brep(scale_to_volume.Scaled)
solid_union = SolidUnion(Breps=[cap_holes_2, scale_to_volume.Scaled])
